vi "imu_data_convert.gvi"   [LabVIEW NXG 1.0.0]
inputs:
  "input string": string
outputs:
  "imu data": T1
types:
  T1 = cluster{"accel x": i16, "accel y": i16, "accel z": i16, "gyro x": i16, "gyro y": i16, "gyro z": i16}
diagram:
  w1 = [0, 0, 0, 0, 0, 0]  # data array
  w2 = T1 {"accel z"=2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}  # data cluster
  Build Cluster($"input string", w1, w2) -> w3
  s1 = w3  # shift register
  for (N = 6) (iteration -> i1) {
    Property Node(instance in=s1) -> ("Element 1"=w4)
    # w4: input string
    Multiply(i1, 4) -> w5
    # s1: context
    w6 = 4  # length
    String Subset(length (rest)=w6, offset (0)=w5, string=w4) -> w7
    w8 = 0  # int16 type val
    Hexadecimal String To Number(default (0 U32)=w8, string=w7) -> (number=w9)
    Property Node(instance in=s1) -> ("Element 2"=w10)
    Replace Array Subset(inArray=w10, index=i1, new=w9) -> w11
    Property Node(instance in=s1, "Element 2"=w11) -> (instance out=w12)
    next s1 = w12
  }
  Property Node(instance in=s1) -> ("Element 3"=w13, "Element 2"=w14)
  Array Index(array=w14) -> (out0[0]=w15, out1[1]=w16, out2[2]=w17, out3[3]=w18, out4[4]=w19, out5[5]=w20)
  Property Node(instance in=w13, "accel x"=w15, "accel y"=w16, "accel z"=w17, "gyro x"=w18, "gyro y"=w19, "gyro z"=w20) -> (instance out=w21)
  $"imu data" <- w21
