vi "main.gvi"   [LabVIEW NXG 1.0.0]
panel controls:
  "stop": bool
  "max nr of bytes": u32 = 50
  "termination char": u8 = 13
  "COM": "Instr" = "COM6"
  "baud rate": u32 = 115200
  "Acquisition mode": i32
  "file name": string = "imu_data.txt"
  "Start": bool
panel indicators:
  "data": string
  "accel x": i16
  "accel y": i16
  "accel z": i16
  "gyro x": i16
  "gyro y": i16
  "gyro z": i16
  "data len": i32
  "[packets/s]": i32
  "error out": error
  "Saving": bool
uses:
  NI::VISA::Open (Instr).gvi
  NI::VISA::Configure Serial Port (Instr).gvi
  NI::VISA::Read (Instr, String).gvi
  NI::G Core::Timing::Elapsed Timer.gvi
  NI::G Core::Error::Is Error.gvi
  NI::VISA::Close (Instr).gvi
  NI::G Core::Error::Display Error.gvi
diagram:
  Get Component Directory() -> (Path=w1)
  Build Path(base path=w1, name or relative path=$"file name") -> (appended path=w2)
  Open Or Create Or Replace File(file path (use dialog)=w2, operation (0:open)="replace or create") -> (error out=w3, refnum out=w4)  # Open/Create/Replace File
  w5 = $"max nr of bytes"
  w6 = $COM
  while {
    stop if $Start
  }
  call "Open (Instr).gvi"(resource name=w6, error in=w3) -> (error out=w7, session out=w8)
  call "Configure Serial Port (Instr).gvi"(data bits=8, session in=w8, baud rate=$"baud rate", parity="None"(0), stop bits="1.0"(10), error in=w7, timeout=15000, termination char=$"termination char", enable termination char=TRUE, flow control="None"(0)) -> (session out=w9, error out=w10)
  w11 = 0  # old i
  s1 = w11  # shift register
  while (iteration -> i1) {
    call "Read (Instr, String).gvi"(session in=w9, error in=w10, byte count=w5) -> (error out=w12, session out=w13, read buffer=w14)
    $data <- w14
    String Length(string=w14) -> (length=w15)
    $"data len" <- w15
    case ($"Acquisition mode") {
      frame 0, Default {
        # Display
        call "imu_data_convert.gvi"(input string=w14) -> (imu data=w20)
        Property Node(instance in=w20) -> ("accel x"=w21, "accel y"=w22, "accel z"=w23, "gyro x"=w24, "gyro y"=w25, "gyro z"=w26)
        $"accel x" <- w21
        $"accel y" <- w22
        $"accel z" <- w23
        $"gyro x" <- w24
        $"gyro y" <- w25
        $"gyro z" <- w26
        call "Elapsed Timer.gvi"(target time=1, reset=FALSE) -> (time has elapsed=w27)
        # Calculate packet rate
        case (w27) {
          frame False, Default {
            w16 = s1
          }
          frame True {
            Subtract(x=i1, y=s1) -> w28
            $"[packets/s]" <- w28
            w16 = i1
          }
        }
        w17 = w12
        w18 = w4
        w19 = FALSE
      }
      frame 1 {
        # Save
        Write To Text File(error in=w12, file (use dialog)=w4, text=w14) -> (error out=w17, refnum out=w18)
        $"error out" <- w17
        call "Is Error.gvi"(error in=w17) -> (error?=w29)
        Not(x=w29) -> w19
        w16 = i1
      }
    }
    Not(x=$stop) -> w30
    Logical And(w19, w30) -> w31
    $Saving <- w31
    call "Is Error.gvi"(error in=w17) -> (error?=w32)
    Logical Or(w32, $stop) -> w33
    next s1 = w16
    stop if w33
  }
  call "Close (Instr).gvi"(session in=w13, error in=w17) -> (error out=w34)
  Close File(error in=w34, refnum=w18) -> (error out=w35)
  call "Display Error.gvi"(error in=w35)
